# Grasshopper definition labels.gh (Grasshopper 0.8.66)

slider = Slider(2000, range=1..2000)
launched = Panel("""1
1
4
5
7
11
19
21
24
26
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""")
stopped = Panel("""52
52
52
67
92
95
134
143
175
185
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""")
attractions = Panel("""360
360
360
360
360
360
360
360
360
360
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""")
visspace = Slider(2.5, range=1..3)
vislength = Slider(13.7, range=10..20)
Y = Slider(0.738, range=0..1)

slider_2 = Slider(0, range=0..255)
rgb = ColourRGB(Alpha=255, Red=slider_2, Green=slider_2, Blue=slider_2)

rgb_2 = ColourRGB(Alpha=255, Red=Slider(255, range=0..255), Green=0, Blue=0)

slider_3 = Slider(150, range=0..255)
rgb_3 = ColourRGB(Alpha=255, Red=slider_3, Green=slider_3, Blue=slider_3)

dom = Domain(DomainStart="0", DomainEnd=Y)
visposition = Slider(0, range=0..10)
ma = MassAddition(Input=attractions)  # -> Result, PartialResults
start_frame = Panel("1228")
start_frame_2 = Panel("882")
visposition_2 = Slider(5, range=0..10)
end_frame = Panel("1500")
visposition_3 = Slider(8, range=0..10)
vb = VBScript(
    frame=slider,
    stFrame=start_frame_2,
    sumTotal=ma.Result,
    sumPartial=ma.PartialResults,
    visLength=vislength,
    visPosition=visposition_2,
    visSpace=visspace)  # -> out, attractions, pL, pM, pV, X, vis; inputs sumPartial: list
# ---------- vb: VB ----------
    Dim duration As int32
    duration = sumPartial.Count()
    Dim endFrame As int32
    endFrame = stFrame + duration
    Dim sumNow As Int32
    Dim percent As Double
    Dim ptLabel As Point3d
    Dim ptMetric As Point3d
    Dim ptVis As Point3d

    ptLabel.Y = -visSpace * visPosition
    ptMetric.Y = -visSpace * visPosition
    ptMetric.X = ptMetric.X + visLength
    ptVis.Y = -visSpace * (visPosition + 1)

    visLength = visLength + 3

    If (frame <= stFrame) Then
      sumNow = 0
    End If

    If (frame > stFrame And frame < endFrame) Then
      sumNow = sumPartial(frame - (stFrame + 1))
    End If

    If (frame >= endFrame) Then
      sumNow = sumTotal
    End If

    percent = sumNow / sumTotal

    attractions = sumNow
    pL = ptLabel
    pM = ptMetric
    pV = ptVis
    X = percent * visLength
    vis = visLength
# ---------- end vb ----------
vb_2 = VBScript(frame=slider, triggerL=launched, triggerS=stopped, visLength=vislength, visPosition=visposition, visSpace=visspace)  # -> out, launched, stopped, active, pL1, pM1, pL2, pM2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; inputs triggerL: list, triggerS: list
# ---------- vb_2: VB ----------
    Dim storedL As int32
    Dim storedS As int32
    Dim storedA As int32
    Dim perAgent As Double

    Dim ptLabel1 As Point3d
    Dim ptMetric1 As Point3d
    Dim ptLabel2 As Point3d
    Dim ptMetric2 As Point3d
    Dim ptLabel3 As Point3d
    Dim ptMetric3 As Point3d
    Dim ptVis1 As Point3d
    Dim ptVis2 As Point3d

    'LAUNCHED
    For i As int32 = 1 To frame Step 1
      If (i < 50) Then
        storedL = 0
      Else
        For j As int32 = 0 To triggerL.count - 1 Step 1
          If ( i.Equals(triggerL(j)) ) Then
            storedL = j + 1
          End If
        Next
      End If
    Next


    'STOPPED
    For i As int32 = 1 To frame Step 1
      For j As int32 = 0 To triggerS.count - 1 Step 1
        If ( i.Equals(triggerS(j)) ) Then
          storedS = j + 1
        End If
      Next
    Next

    storedA = storedL - storedS


    ptLabel1.Y = -visSpace * visPosition
    ptMetric1.Y = -visSpace * visPosition
    ptMetric1.X = ptMetric1.X + visLength
    ptLabel2.Y = -visSpace * (visPosition + 1)
    ptMetric2.Y = -visSpace * (visPosition + 1)
    ptMetric2.X = ptMetric2.X + visLength
    ptLabel3.Y = -visSpace * (visPosition + 2)
    ptMetric3.Y = -visSpace * (visPosition + 2)
    ptMetric3.X = ptMetric3.X + visLength

    visLength = visLength + 3
    perAgent = visLength / triggerL.Count

    launched = storedL
    stopped = storedS
    active = storedA
    xL = launched * perAgent
    xS = stopped * perAgent
    xA = active * perAgent

    ptVis1.Y = -visSpace * (visPosition + 3)
    ptVis2.Y = ptVis1.Y
    ptVis2.X = ptVis2.X + xA

    pL1 = ptLabel1
    pM1 = ptMetric1
    pL2 = ptLabel2
    pM2 = ptMetric2
    pL3 = ptLabel3
    pM3 = ptMetric3
    pV1 = ptVis1
    pv2 = ptVis2
# ---------- end vb_2 ----------
vb_3 = VBScript(frame=slider, stFrame=start_frame, endFrame=end_frame, visLength=vislength, visPosition=visposition_3, visSpace=visspace)  # -> out, bundled, pL, pM, pV, X, vis
# ---------- vb_3: VB ----------
    Dim duration As int32
    duration = endFrame - stFrame
    Dim percent As Double
    Dim ptLabel As Point3d
    Dim ptMetric As Point3d
    Dim ptVis As Point3d

    ptLabel.Y = -visSpace * visPosition
    ptMetric.Y = -visSpace * visPosition
    ptMetric.X = ptMetric.X + visLength
    ptVis.Y = -visSpace * (visPosition + 1)

    visLength = visLength + 3

    If (frame < stFrame) Then
      percent = 0
    End If

    If (frame >= stFrame And frame < endFrame) Then
      percent = (frame - stFrame) / duration
    End If

    If (frame >= endFrame) Then
      percent = 1
    End If

    bundled = Math.Round((percent * 100), 0) & "%"
    pL = ptLabel
    pM = ptMetric
    pV = ptVis
    X = percent * visLength
    vis = visLength
# ---------- end vb_3 ----------
rectangle = Rectangle(Plane=vb_2.pV1, XSize=vb_2.xL, YSize=dom, Radius=0)  # -> Rectangle, Length
rectangle_2 = Rectangle(Plane=vb_2.pV1, XSize=vb_2.xA, YSize=dom, Radius=0)  # -> Rectangle, Length
rectangle_3 = Rectangle(Plane=vb_2.pV2, XSize=vb_2.xS, YSize=dom, Radius=0)  # -> Rectangle, Length
rectangle_4 = Rectangle(Plane=vb.pV, XSize=vb.X, YSize=dom, Radius=0)  # -> Rectangle, Length
rectangle_5 = Rectangle(Plane=vb.pV, XSize=vb.vis, YSize=dom, Radius=0)  # -> Rectangle, Length
rectangle_6 = Rectangle(Plane=vb_3.pV, XSize=vb_3.X, YSize=dom, Radius=0)  # -> Rectangle, Length
rectangle_7 = Rectangle(Plane=vb_3.pV, XSize=vb_3.vis, YSize=dom, Radius=0)  # -> Rectangle, Length
planar = PlanarSrf(Edges=rectangle_4.Rectangle)
planar_2 = PlanarSrf(Edges=rectangle_6.Rectangle)
planar_3 = PlanarSrf(Edges=rectangle_2.Rectangle)
planar_4 = PlanarSrf(Edges=rectangle_3.Rectangle)
tag = TextTag3D(Location=vb_2.pL1, Text="agents launched:", Size=1, Colour=rgb_2)
tag_2 = TextTag3D(Location=vb_2.pL2, Text="reached target:", Size=1, Colour=rgb_3)
tag_3 = TextTag3D(Location=vb_2.pL3, Text="active agents:", Size=1, Colour=rgb)
tag_4 = TextTag3D(Location=vb_2.pM1, Text=vb_2.launched, Size=1, Colour=rgb_2)
tag_5 = TextTag3D(Location=vb_2.pM2, Text=vb_2.stopped, Size=1, Colour=rgb_3)
tag_6 = TextTag3D(Location=vb_2.pM3, Text=vb_2.active, Size=1, Colour=rgb)
preview = CustomPreview(Geometry=rectangle.Rectangle, Shader=rgb_2)
preview_2 = CustomPreview(Geometry=planar_3, Shader=rgb)
preview_3 = CustomPreview(Geometry=planar_4, Shader=rgb_3)
tag_7 = TextTag3D(Location=vb.pL, Text="attractions:", Size=1, Colour=rgb)
tag_8 = TextTag3D(Location=vb.pM, Text=vb.attractions, Size=1, Colour=rgb)
preview_4 = CustomPreview(Geometry=planar, Shader=rgb)
preview_5 = CustomPreview(Geometry=rectangle_5.Rectangle, Shader=rgb)
tag_9 = TextTag3D(Location=vb_3.pL, Text="bundling complete:", Size=1, Colour=rgb)
tag_10 = TextTag3D(Location=vb_3.pM, Text=vb_3.bundled, Size=1, Colour=rgb)
preview_6 = CustomPreview(Geometry=planar_2, Shader=rgb)
preview_7 = CustomPreview(Geometry=rectangle_7.Rectangle, Shader=rgb)
