# Grasshopper definition ORGANICITIES_AuxinFlux.gh (Grasshopper 0.9.76)

# ----
# DESIGN.EPFL.CH/ORGANICITES
# ORGANICITIES: Definition originally written by:
#             Trevor Patt
# 
# 
#   in collaboration with the MediaxDesign Lab, EPFL
# 
#   Creative Commons:
#     Attribution
#     NonCommercial
#     ShareAlike
# 0111-2014
# SOURCE: Auxin Flux Canalisation algorithm developed by Adam Runions, et al:
# http://algorithmicbotany.org/papers/
# venation.sig2005.html
# 
# and Nervous System: http://vimeo.com/25604611
inputpanel = Panel("{100,-100,0}")
srf4pt = _4PointSurface(CornerA="{100,100,0}", CornerB="{-100,100,0}", CornerC="{-100,-100,0}", CornerD=inputpanel)
srf = Surface(reparameterize(srf4pt))

# ---- group: Generate Origin and Direction
pline = PolyLine(Vertices=["{100,100,0}", "{-100,100,0}", "{-100,-100,0}", inputpanel], Closed=True)
crv_boundary = Curve(pline)
srf_2 = Surface(reparameterize(srf4pt))
popgeo = PopulateGeometry(Geometry=srf_2, Count=Slider(4, range=0..10), Seed=1)
pt_randomorigin = Point(popgeo)
prox = Proximity3D(Points=popgeo, Group=5)  # -> Links, Topology
crv_dir = Curve(prox.Links)

# ---- group: Generate Target Points
slider = Slider(200, range=0..200)
random = Random(Range=Domain(0, 1), Number=slider, Seed=2, Integers=False)
random_2 = Random(Range=Domain(0, 1), Number=slider, Seed=1, Integers=False)
srf_3 = Surface(reparameterize(srf4pt))
vec = VectorXYZ(XComponent=random, YComponent=random_2, ZComponent=0)  # -> Vector, Length
eval = EvaluateSurface(Surface=srf_3, Point=vec.Vector)  # -> Point, Normal, Frame

# ---- group: AUXIN FLUX CANALISATION / PRIMARY SETTINGS
distance_threshold = Slider(1, range=0..5)
# Lines with start point at an origin
step_size = Slider(5.2, range=0.5..50)
branch = Slider(0.89, range=0..1)
ang_2pi_search_angle = Slider(0.3, range=0.2..0.6)
_5_of_iter = Slider(359, range=1..359)

# ---- group: ADDITIONAL CONSTRAINTS
# 0 = use calculated direction
# .5 = average calculated and ortho directions
# 1 = use ortho direction
_1st_step_ortho = Slider(0.69, range=0..1)
_1st_step_multiplier = Slider(0.9, range=0.2..4)
_1_xx_slope = Slider(12, range=1..100)

# ---- group: AUXIN FLUX CANALISATION
# A = points structured by paths
# B = flat list of all points (w/o duplicate)
# C = intersection points
random_seed = Slider(7, range=1..20)
pt_randomorigin_2 = Point(popgeo)
target_pts = Point(eval.Point)
crv_dir_2 = Curve(prox.Links)

# ----
crv_boundary_2 = Curve(pline)
vb = VBScript(
    pts=flatten(pt_randomorigin_2),
    dir=flatten(crv_dir_2),
    bnd=flatten(crv_boundary_2),
    stim=flatten(target_pts),
    stp=step_size,
    thrs=distance_threshold,
    prob=branch,
    ang=ang_2pi_search_angle,
    limit=_5_of_iter,
    slope=_1_xx_slope,
    stpX=_1st_step_multiplier,
    ortho=_1st_step_ortho,
    sd=random_seed)  # -> out, A, B, C, D; inputs pts: list of Point3d, dir: list of Line, bnd: list of Curve, stim: list of Point3d
# ---------- vb: VB ----------
    'INITIALIZE VARIABLES
    Dim R As New Random(sd)

    Dim dirList As New List(Of Vector3d)
    Dim endPts As New List(Of Point3d)
    Dim endAlive As New list(Of Boolean)
    Dim endCt As int32 = 0
    Dim ptOut As New dataTree(Of point3d)
    Dim ptAll As New List(Of point3d)
    Dim intpt As New list(Of point3d)
    Dim stimAlive As New list(Of Boolean)
    Dim bndPtAll As New List(Of point3d)
    Dim srcTag As New DataTree(Of int32)

    Dim ckEx As New List(Of Point3d)

    'MAKE POINTS LIST ptAll
    For i As int32=0 To pts.Count - 1
      ptAll.add(pts(i))
    Next
    'MAKE TAG FOR stim POINTS
    For i As int32=0 To stim.Count - 1
      stimAlive.add(True)
    Next

    'FIND VIABLE START DIRECTIONS
    For j As int32=0 To dir.Count - 1
      Dim pthJ As New gh_path(j)
      For i As int32=0 To pts.Count - 1
        If dir(j).pointat(0) = pts(i) Then
          dirList.add(dir(j).direction)
          dirList(i) *= stp / dirList(i).length
          endPts.Add(pts(i))
          endAlive.add(True)
          endCt += 1
          ptOut.add(pts(i), pthJ)
          srcTag.add(i, pthJ)
          Exit For
        End If
      Next
    Next

    'BEGIN AUXIN-FLUX CANILISATION LOOP
    'INITIALIZE COUNTER
    Dim loopct As int32 = 0

    'CHECK END CONDITION (endCt=0 → NO MORE VIABLE PATHS) AND COUNTER LIMIT loopCt
    Do While endCt > 0 And loopCt < limit * 5
      For i As int32=0 To endPts.Count - 1
        Dim pthI As New gh_path(i)

        If endAlive(i) Then
          'CHECK BOUNDARY EDGE
          Dim edgck As Boolean = False
          Dim bndPt As New point3d(0, 0, 0)
          For m As int32=0 To bnd.Count - 1
            Dim tval As Double
            bnd(m).closestpoint(endPts(i), tval)
            Dim xyPt As New point3d(bnd(m).pointat(tval).X, bnd(m).pointat(tval).y, endPts(i).z)
            Dim dist As Double = endPts(i).distanceto(xyPt)

            'IF END POINT endPts(i) IS CLOSE TO BOUNDARY
            If dist < stp Then
              'CHECK THE ANGLE (PERMIT PATHS POINTED AWAY FROM BOUNDARY TO CONTINUE, KILL PATHS POINTED TOWARD IT)
              Dim vecBnd As New vector3d(xyPt - endPts(i))
              Dim theta As Double = math.Acos((dirList(i) * vecBnd) / (dirList(i).length * vecBnd.Length))
              If math.Abs(theta) < math.PI * 1.5 * ang Then
                ptAll.Add(xyPt)
                ckEx.Add(xyPt)

                endAlive(i) = False
                endCt -= 1
                edgck = True
                bndPt = xyPt
                bndPtAll.Add(bndPt)
                Exit For
              End If

            End If
          Next

          'INCLUDE LAST POINT ON BOUNDARY IF edgck = True
          If edgck Then
            'CHECK FOR EXISTING POINTS
            Dim bndMin As Double = 10000
            Dim bndNdx As int32 = -1
            For g As int32=0 To bndPtAll.count - 2
              Dim bndDist As Double = bndPt.DistanceTo(bndPtAll(g))
              If bndDist < bndMin Then
                bndMin = bndDist
                bndNdx = g
              End If
            Next

            If bndMin < stp * 1 AndAlso bndNdx >= 0 Then
              ptOut.add(bndPtAll(bndNdx), pthI)
            Else
              ptOut.Add(bndPt, pthI)
            End If
          End If



          'CHECK UPCOMING INTERSECTIONS
          If endAlive(i) Then
            Dim intck As Boolean = False
            For m As int32=0 To ptAll.count - 1
              Dim vecCk As New vector3d(ptAll(m) - endPts(i))
              If vecCk.Length < (stp * 1.3) AndAlso vecCk.Length > 0  Then
                Dim theta As Double = math.Acos((dirList(i) * vecCk) / (dirList(i).length * vecCK.Length))
                If math.Abs(theta) < math.PI * ang Then
                  ptOut.add(ptAll(m), pthI)
                  intpt.add(ptAll(m))
                  endAlive(i) = False
                  endCt -= 1
                  intck = True
                  Exit For
                End If
              End If
            Next
            If intck Then
              Exit For
            Else
              'ptAll.Add(endPts(i))  *ALREADY ADDED
            End If
          End If

          'CHECK STIMULUS POINTS
          If endAlive(i) Then
            Dim vecStp As New vector3d(0, 0, 0)

            'DISTANCE TO stim POINTS
            For j As int32=0 To stim.Count - 1
              Dim vecCk As New vector3d(stim(j) - endPts(i))
              If (stimAlive(j)) Then
                If vecCk.Length < thrs Then
                  'COMMENTED SECTION KILLS PATHS WHEN THEY REACH STIMULUS POINTS,
                  'endAlive(i) = False
                  'endCt -= 1
                  'vecCk = New vector3d(0, 0, 0)

                  'BUT BETTER RESULTS ACHIEVED BY KILLING STIMULUS POINTS INSTEAD AND ALLOWING PATHS TO FLOW PAST THEM
                  stimAlive(j) = False
                  Exit For
                End If
              End If

              Dim theta As Double = math.Acos((dirList(i) * vecCk) / (dirList(i).length * vecCK.Length))
              If math.Abs(theta) < math.PI * ang Then
                vecCk.Unitize
                vecStp += vecCk
              End If
            Next



            If endAlive(i) Then
              If vecStp.length > 0 Then

                'CONSTRAIN SLOPE TO 1:slope
                'MAKE A NEW VECTOR OF THE XY-COMPONENTS
                Dim vecPlane As New vector3d (vecStp.X, vecStp.Y, 0)
                'IF THE VECTOR HAS A Z-COMPONENT AND RUN:RISE > SLOPE:1 RESET THE Z COMPONENT
                If vecStp.Z <> 0 AndAlso math.abs(vecPlane.Length / vecStp.Z) < slope Then
                  vecStp.z = (vecPlane.length / slope) * (vecStp.Z / math.Abs(vecStp.Z))
                End If

                'ADJUST FIRST BRANCH BY USER INPUT VARIABLES
                If ptout.branch(pthI).count = 1 Then
                  vecStp *= ((1 - ortho) / (vecStp.length))
                  vecStp += dirList(i) * (ortho / ( dirList(i).length))
                  vecStp *= stpX * stp
                Else
                  vecStp *= stp / vecStp.length
                End If



                'CHECK CURRENT ADJACENCIES
                Dim intck As Boolean = False
                For m As int32=0 To ptAll.count - 1
                  Dim vecCk As New vector3d(ptAll(m) - (endPts(i) + vecStp))
                  If vecCk.Length < (stp * .33) AndAlso vecCk.Length > 0  Then

                    ptOut.add(ptAll(m), pthI)
                    intpt.add(ptAll(m))
                    endAlive(i) = False
                    endCt -= 1
                    intck = True
                    Exit For

                  End If
                Next
                If intck Then
                  'ADJACENT EXISTING POINT
                Else
                  ptAll.Add(endPts(i) + vecStp)
                  'ADD NEW POINT TO OUTPUT
                  ptOut.add(New Point3d(endPts(i) + vecStp), pthI)
                End If

                If  endAlive(i) Then
                  Dim branchCk As Double = R.NextDouble
                  'ADD NEW BRANCH
                  If branchCk < prob Then
                    Dim pthNxt As New GH_Path(endPts.Count)
                    ptout.add(endPts(i), pthNxt)
                    Dim pthTag As New Gh_path(i)
                    srcTag.add(srcTag(pthTag, 0), pthNxt)

                    endPts.Add(endPts(i))
                    endAlive.add(True)
                    endCt += 1
                    endPts(i) = endPts(i) + vecStp
                    dirList(i) = vecStp

                    Dim vecPerp As New vector3d
                    vecPerp = vector3d.CrossProduct(dirList(i), vector3d.ZAxis)
                    vecPerp *= ((math.Round(r.NextDouble) - .5) * 2) * stp / vecPerp.Length
                    dirList.Add(vecPerp)
                  Else
                    endPts(i) = endPts(i) + vecStp
                    dirList(i) = vecStp
                  End If
                End If

              End If
            End If
          End If
        End If

      Next
      loopct += 1
    Loop

    a = ptout
    b = ptAll
    c = srcTag
    d= intpt
# ---------- end vb ----------
pline_2 = PolyLine(Vertices=vb.A, Closed=False)
target_pts_2 = Point(eval.Point)
