# Grasshopper definition ORGANICITIES_ConstrainedAgents.gh (Grasshopper 0.9.76)

# DESIGN.EPFL.CH/ORGANICITES
# ORGANICITIES: Definition originally written by:
#              Trevor Patt
# 
# 
#   in collaboration with the MediaxDesign Lab, EPFL
# 
#   Creative Commons:
#     Attribution
#     NonCommercial
#     ShareAlike
# 0111-2014
inputpanel = Panel("""{5,1,0}
{2,2,0}
{0,5,0}
{1,3,0}
{-5,5,0}""")

pt_cntr = Point("{0,0,0}")
pts = Point(inputpanel)

lng = ListLength(List=pts)
random = Random(Range="0 to 2.0*PI", Number=lng, Seed=2)
eval = Evaluate(F="{cos(x),sin(x),0}", x=random)

vb = VBScript(
    cntr=pt_cntr,
    rad=Slider(20, range=0..100),
    pts=pts,
    thrs=Slider(4.2, range=0..10),
    stps=Slider(78, range=0..200),
    vec=eval)  # -> out, A, B, C, D; inputs cntr: Point3d, pts: list of Point3d, vec: list of Vector3d
# ---------- vb: VB ----------
    Dim trace As New list(Of polyline)
    Dim linout As New List(Of line)
    For j As int32=0 To pts.Count - 1
      trace.add(New polyline)
      trace(j).add(pts(j))
    Next
    'loop for each step
    For i As Integer=0 To stps
      'loop through all points
      For j As Integer=0 To pts.Count - 1
        'compare points to points later in list
        For k As int32=j + 1 To pts.Count - 1
          Dim vecCHCK As New vector3d(pts(j) - pts(k))
          If vecCHCK.Length < thrs Then
            'move away
            vec(j) += (vecChck / vecChck.Length) * 0.3
            vec(k) -= (vecChck / vecChck.Length) * 0.3
            linout.add(New line(pts(j), pts(k)))
          End If
        Next

        Dim vecCntr As New Vector3d(cntr.x - pts(j).x, cntr.y - pts(j).y, 0)
        If vecCntr.Length > rad Then
          vec(j) += (vecCntr / vecCntr.Length) * 0.3
        End If

        'apply step
        vec(j).unitize
        pts(j) += vec(j)
        pts(j) += vector3d.ZAxis
        trace(j).add(pts(j))
      Next
    Next
    'output trace
    a = pts
    b = vec
    c = trace
    d = linout
# ---------- end vb ----------
