# Grasshopper definition ORGANICITIES_Cracking.gh (Grasshopper 0.9.76)

# DESIGN.EPFL.CH/ORGANICITES
# ORGANICITIES: Definition originally written by:
#             Trevor Patt
# 
# 
#   in collaboration with the MediaxDesign Lab, EPFL
# 
#   Creative Commons:
#     Attribution
#     NonCommercial
#     ShareAlike
# 0111-2014
inputpanel = Panel("""{10,10,0}
{-10,10,0}
{-10,-10,0}
{10,-10,0}""")
pt = Point(inputpanel)
pline = PolyLine(Vertices=pt, Closed="true")

# ---- group: Inputs
crv = Curve(pline)
module = Slider(1.69, range=0.1..10)
seed = Slider(4, range=0..10)
explode = Explode(Curve=crv, Recursive=True)  # -> Segments, Vertices
vb_cracking = VBScript(pts=explode.Vertices, z=module, sd=seed)  # -> out, C; inputs pts: list of Point3d
# ---------- vb_cracking: VB ----------
    Dim basect As Int32 = pts.count
    Dim pLine As New list (Of Polyline)
    'EXIT VARIABLES

    Dim ctck As Int32 = 0
    Dim basecrv As New Polyline

    For i As int32=0 To basect - 1
      basecrv.Add(pts(i))
    Next

    pLine.Add(basecrv)


    Call PolyCrack(pLine, pLine(0), z, sd, ctck)

    c = pLine
# ---------- vb_cracking: VB additional code ----------
  Sub RandomSide (ByVal rsd As Random, ByVal ct As Int32, ByRef s As Int32, ByRef t As Int32)

    s = math.floor(Rsd.nextdouble * (ct))

    'AS A SEGMENT BETWEEN pts(s) AND pts(s+1)

    'FIND NEXT SEGMENT + / - :2 (random value converted to +/ _, added to s; Mod to loop

    Dim posneg As Int32 = 4 * (math.Round(rsd.nextdouble) - 0.5)

    t = (s + posneg + ct) Mod (ct)


    'SORT s AND t IN ORDER
    If (s > t) Then
      Dim temp As Int32 = s
      s = t
      t = temp
    End If
  End Sub


  Function SideDivide (ByVal pts As list (Of Point3d),
    ByVal x As int32,
    ByVal z As Double,
    ByVal ct As Int32,
    ByVal rsd As Random) As Double

    'GET SEGMENT LENGTH BY THE DISTANCE BETWEEN TWO VERTICES
    Dim lng As Double = pts(x).distanceto(pts((x + 1) Mod (ct)))

    'GET NUMBER OF TIMES n DIMENSION z WILL FIT IN SEGMENT x
    Dim n As Int32 = math.Floor(lng / z)

    'SELECT A RANDOM NUMBER OF z DIMENSIONS AS A DISTANCE ALONG SEGMENT x
    Dim dist As Double = Math.Round(rsd.NextDouble * n) * z

    'FIND DESIRED DISTANCE AS % OF SEGMENT LENGTH
    SideDivide = dist / lng
  End Function


  Function DrawSubCrv(ByVal x As int32, ByVal toval As int32, ByVal ct As int32,
    ByVal peripts As list(Of Point3d), ByVal splptA As Point3d, ByVal splptB As Point3d) As Polyline

    'STARTING AT splptA ADD POINTS AROUND PERIMETER
    Dim crv As New Polyline
    crv.Add(splptA)

    For i As int32 = 1 To toval
      crv.Add(peripts((i + x) Mod ct))
    Next
    crv.Add(splptB)
    crv.Add(splptA)


    DrawSubCrv = crv
  End Function

  Function GetVrtx(ByVal crv As Polyline, ByVal ct As Int32) As List (Of Point3d)

    Dim ptlist As New List(Of Point3d)
    For i As int32=0 To ct
      ptlist.Add(crv(i))
    Next
    GetVrtx = ptlist
  End Function


  Sub Polycrack (ByRef pLine As list (Of Polyline),
    ByVal pL As Polyline,
    ByVal z As Double,
    ByVal sd As Int32,
    ByRef ctck As Int32)


    Dim distck As Double
    Dim ct As int32 = pL.Count
    Dim cPts As New List (Of Point3d)
    cPts = GetVrtx(pL, ct - 1)

    'USE R TO INSURE CONSISTENT RANDOM PATTERNS
    Dim R As New Random (sd + ctck)
    Dim s As Int32 = 0
    Dim t As int32 = 0
    Dim splitPts As New List (Of Point3d)
    RandomSide(R, ct - 1, s, t)


    'FIND POINT AT % ON SEGMENT s
    Dim pct As Double = SideDivide(cPts, s, z, ct - 1, r)
    If (pct > 1) Then Exit Sub

    Dim ptA As New POint3d (cPts(s) + (cPts(s + 1) - cPts(s)) * pct)

    'FIND POINT AT z% ON SEGMENT t

    pct = SideDivide(cPts, t, z, ct - 1, r)
    If (pct > 1) Then Exit Sub

    Dim ptb As New Point3d(cPts(t) + (cPts((t + 1) Mod (ct - 1)) - cPts(t)) * pct)
    distck = ptA.DistanceTo(ptB)
    If (distck < 2 * z) Then Exit Sub

    'DRAW FIRST POLYLINE
    Dim Crv1 As New Polyline(DrawSubCrv(s, (t - s), (ct - 1), cPts, ptA, ptB))
    pLine.Add(Crv1)
    Call PolyCrack(pLine, crv1, z, sd, ctck)

    'DRAW SECOND POLYLINE
    Dim crv2 As New Polyline(DrawSubCrv(t, (ct - 1) - (t - s), ct - 1, cPts, ptB, ptA))
    pLine.Add(crv2)
    Call PolyCrack(Pline, crv2, z, sd, ctck)

  End Sub
# ---------- end vb_cracking ----------
crv_cracks = Curve(vb_cracking.C)

# ----
crv_cracks_2 = Curve(vb_cracking.C)
crv_cracks_3 = Curve(vb_cracking.C)

# ---- group: Cull Curves with Large Area
area = Area(Geometry=crv_cracks_2)  # -> Area, Centroid
smaller = SmallerThan(FirstNumber=area.Area, SecondNumber=Slider(10, range=0..100))  # -> SmallerThan, OrEqualTo
dispatch = Dispatch(List=crv_cracks_3, DispatchPattern=smaller.SmallerThan)  # -> ListA, ListB
crv_culled = Curve(graft(dispatch.ListA))

# ---- group: Extrude Curves Proportional to Area
crv_culled_2 = Curve(graft(dispatch.ListA))
area_2 = Area(Geometry=crv_culled_2)  # -> Area, Centroid
boundary = BoundarySurfaces(Edges=crv_culled_2)
Z = UnitZ(Factor=area_2.Area)
extr = Extrude(Base=boundary, Direction=Z)
