# Grasshopper definition ORGANICITIES_Lichen.gh (Grasshopper 0.9.76)

# ----
# DESIGN.EPFL.CH/ORGANICITES
# ORGANICITIES: Definition originally written by:
#              Jonathan Hermann, Martin Wyss and Marion Spillmann
# 
# 
#   in collaboration with the MediaxDesign Lab, EPFL
# 
#   Creative Commons:
#     Attribution
#     NonCommercial
#     ShareAlike
size_of_field = Slider(61, range=0..100)
number_of_particles = Slider(310, range=0..1000)
# 0111-2014
md_slider = MDSlider(
    slider_value=Point(0.490441588, 0.50449055, 0.5),
    SliderMode=0,
    x_domain=Domain(0, 1),
    y_domain=Domain(0, 1),
    z_domain=Domain(0, 1))

pcomp = Deconstruct(Point=md_slider)  # -> XComponent, YComponent, ZComponent
vb = VBScript(d=size_of_field, n=number_of_particles, spx=pcomp.XComponent, spy=pcomp.XComponent)  # -> out, A, B
# ---------- vb: VB ----------
    'd=side length of field
    'n=length of final vectlist
    Dim coord(2,(n-1)) As Integer          'matrix for coordinates
    Dim veclist As New List(Of Vector3d) 'list of definitive coordinates
    Dim linelist As New List(Of Line)
    Dim dir As Integer
    Dim oldpoint As Point3d
    Dim newpoint As Point3d


    'check if number of particles bigger than possible particle locations
    If n > d ^ 3 Then n = d ^ 3

    'starting point from MDslider
    spx = spx * (d - 1)
    spy = spy * (d - 1)
    coord(0, 0) = spx
    coord(1, 0) = spy
    coord(2, 0) = 0

    'output of the first set of coordinates
    vecList.Add(New Vector3d(coord(0, 0), coord(1, 0), coord(2, 0)))

    For i As Integer= 1 To n - 1
      'creates a new random point
      newrandompoint:
      coord(0, i) = Int((d) * Rnd())
      coord(1, i) = Int((d) * Rnd())
      coord(2, i) = Int((d) * Rnd())


      'check if coordinates coincide with already existing point
      For j As Integer=0 To i - 1
        If coord(0, j) = coord(0, i) And coord(1, j) = coord(1, i) And coord(2, j) = coord(2, i) Then GoTo newrandompoint
      Next

      checkneighbour:
      'check if there's a neighbouring point
      For j As Integer=0 To i - 1
        Dim distx As Double = math.abs(coord(0, j) - coord(0, i))
        Dim disty As Double = math.abs(coord(1, j) - coord(1, i))
        Dim distz As Double = math.abs(coord(2, j) - coord(2, i))

        If  distx <= 1 And disty <= 1 And distz <= 1Then
          coord(2, i) = coord(2, j) + 1
          newpoint = New Point3d(coord(0, i), coord(1, i), coord(2, i))
          oldpoint = New Point3d(coord(0, j), coord(1, j), coord(2, j))
          GoTo downlow
        End If
      Next


      'move point in random direction
      dir = int((26 * rnd()) + 1)
      Select Case dir
        Case 1
          coord(2, i) = coord(2, i) + 1
        Case 2
          coord(1, i) = coord(1, i) + 1
          coord(2, i) = coord(2, i) + 1
        Case 3
          coord(0, i) = coord(0, i) + 1
          coord(1, i) = coord(1, i) + 1
          coord(2, i) = coord(2, i) + 1
        Case 4
          coord(0, i) = coord(0, i) + 1
          coord(2, i) = coord(2, i) + 1
        Case 5
          coord(0, i) = coord(0, i) + 1
          coord(1, i) = coord(1, i) - 1
          coord(2, i) = coord(2, i) + 1
        Case 6
          coord(1, i) = coord(1, i) - 1
          coord(2, i) = coord(2, i) + 1
        Case 7
          coord(0, i) = coord(0, i) - 1
          coord(1, i) = coord(1, i) - 1
          coord(2, i) = coord(2, i) + 1
        Case 8
          coord(0, i) = coord(0, i) - 1
          coord(2, i) = coord(2, i) + 1
        Case 9
          coord(0, i) = coord(0, i) - 1
          coord(1, i) = coord(1, i) + 1
          coord(2, i) = coord(2, i) + 1
        Case 10
          coord(1, i) = coord(1, i) + 1
        Case 11
          coord(0, i) = coord(0, i) + 1
          coord(1, i) = coord(1, i) + 1
        Case 12
          coord(0, i) = coord(0, i) + 1
        Case 13
          coord(0, i) = coord(0, i) + 1
          coord(1, i) = coord(1, i) - 1
        Case 14
          coord(1, i) = coord(1, i) - 1
        Case 15
          coord(0, i) = coord(0, i) - 1
          coord(1, i) = coord(1, i) - 1
        Case 16
          coord(0, i) = coord(0, i) - 1
        Case 17
          coord(0, i) = coord(0, i) - 1
          coord(1, i) = coord(1, i) + 1
        Case 18
          coord(1, i) = coord(1, i) + 1
          coord(2, i) = coord(2, i) - 1
        Case 219
          coord(0, i) = coord(0, i) + 1
          coord(1, i) = coord(1, i) + 1
          coord(2, i) = coord(2, i) - 1
        Case 20
          coord(0, i) = coord(0, i) + 1
          coord(2, i) = coord(2, i) - 1
        Case 21
          coord(0, i) = coord(0, i) + 1
          coord(1, i) = coord(1, i) - 1
          coord(2, i) = coord(2, i) - 1
        Case 22
          coord(1, i) = coord(1, i) - 1
          coord(2, i) = coord(2, i) - 1
        Case 23
          coord(0, i) = coord(0, i) - 1
          coord(1, i) = coord(1, i) - 1
          coord(2, i) = coord(2, i) - 1
        Case 24
          coord(0, i) = coord(0, i) - 1
          coord(2, i) = coord(2, i) - 1
        Case 25
          coord(0, i) = coord(0, i) - 1
          coord(1, i) = coord(1, i) + 1
          coord(2, i) = coord(2, i) - 1
        Case 26
          coord(2, i) = coord(2, i) - 1
      End Select

      'check if point still in the field
      If coord(0, i) > d - 1 Or coord(1, i) > d - 1 Or coord(1, i) > d - 1 Or coord(0, i) < 0 Or coord(1, i) < 0 Or coord(2, i) < 0 Then
        GoTo newrandompoint
      End If

      GoTo checkneighbour

      downlow:
      'adds coordinates to the output
      vecList.Add(New Vector3d(coord(0, i), coord(1, i), coord(2, i)))
      linelist.Add(New Line(oldpoint, newpoint))

    Next

    A = veclist
    B = linelist
# ---------- end vb ----------

vb_2 = DotNETVBScriptLEGACY(d=size_of_field, n=number_of_particles, spx=pcomp.XComponent, spy=pcomp.YComponent)  # -> out, A, B
# ---------- vb_2: VB ----------
    'd=side length of field
    'n=length of final vectlist
    Dim coord(2,(n-1)) As Integer          'matrix for coordinates
    Dim veclist As New List(Of On3dVector) 'list of definitive coordinates
    Dim linelist As New List(Of Online)
    Dim dir As Integer
    Dim oldpoint As On3dPoint
    Dim newpoint As On3dPoint


    'check if number of particles bigger than possible particle locations
    If n > d ^ 3 Then n = d ^ 3

    'starting point from MDslider
    spx = spx * (d - 1)
    spy = spy * (d - 1)
    coord(0, 0) = spx
    coord(1, 0) = spy
    coord(2, 0) = 0

    'output of the first set of coordinates
    vecList.Add(New On3dVector(coord(0, 0), coord(1, 0), coord(2, 0)))

    For i As Integer= 1 To n - 1
      'creates a new random point
      newrandompoint:
      coord(0, i) = Int((d) * Rnd())
      coord(1, i) = Int((d) * Rnd())
      coord(2, i) = Int((d) * Rnd())


      'check if coordinates coincide with already existing point
      For j As Integer=0 To i - 1
        If coord(0, j) = coord(0, i) And coord(1, j) = coord(1, i) And coord(2, j) = coord(2, i) Then GoTo newrandompoint
      Next

      checkneighbour:
      'check if there's a neighbouring point
      For j As Integer=0 To i - 1
        Dim distx As Double = math.abs(coord(0, j) - coord(0, i))
        Dim disty As Double = math.abs(coord(1, j) - coord(1, i))
        Dim distz As Double = math.abs(coord(2, j) - coord(2, i))

        If  distx <= 1 And disty <= 1 And distz <= 1Then
          coord(2, i) = coord(2, j) + 1
          newpoint = New on3dpoint(coord(0, i), coord(1, i), coord(2, i))
          oldpoint = New on3dpoint(coord(0, j), coord(1, j), coord(2, j))
          GoTo downlow
        End If
      Next


      'move point in random direction
      dir = int((26 * rnd()) + 1)
      Select Case dir
        Case 1
          coord(2, i) = coord(2, i) + 1
        Case 2
          coord(1, i) = coord(1, i) + 1
          coord(2, i) = coord(2, i) + 1
        Case 3
          coord(0, i) = coord(0, i) + 1
          coord(1, i) = coord(1, i) + 1
          coord(2, i) = coord(2, i) + 1
        Case 4
          coord(0, i) = coord(0, i) + 1
          coord(2, i) = coord(2, i) + 1
        Case 5
          coord(0, i) = coord(0, i) + 1
          coord(1, i) = coord(1, i) - 1
          coord(2, i) = coord(2, i) + 1
        Case 6
          coord(1, i) = coord(1, i) - 1
          coord(2, i) = coord(2, i) + 1
        Case 7
          coord(0, i) = coord(0, i) - 1
          coord(1, i) = coord(1, i) - 1
          coord(2, i) = coord(2, i) + 1
        Case 8
          coord(0, i) = coord(0, i) - 1
          coord(2, i) = coord(2, i) + 1
        Case 9
          coord(0, i) = coord(0, i) - 1
          coord(1, i) = coord(1, i) + 1
          coord(2, i) = coord(2, i) + 1
        Case 10
          coord(1, i) = coord(1, i) + 1
        Case 11
          coord(0, i) = coord(0, i) + 1
          coord(1, i) = coord(1, i) + 1
        Case 12
          coord(0, i) = coord(0, i) + 1
        Case 13
          coord(0, i) = coord(0, i) + 1
          coord(1, i) = coord(1, i) - 1
        Case 14
          coord(1, i) = coord(1, i) - 1
        Case 15
          coord(0, i) = coord(0, i) - 1
          coord(1, i) = coord(1, i) - 1
        Case 16
          coord(0, i) = coord(0, i) - 1
        Case 17
          coord(0, i) = coord(0, i) - 1
          coord(1, i) = coord(1, i) + 1
        Case 18
          coord(1, i) = coord(1, i) + 1
          coord(2, i) = coord(2, i) - 1
        Case 219
          coord(0, i) = coord(0, i) + 1
          coord(1, i) = coord(1, i) + 1
          coord(2, i) = coord(2, i) - 1
        Case 20
          coord(0, i) = coord(0, i) + 1
          coord(2, i) = coord(2, i) - 1
        Case 21
          coord(0, i) = coord(0, i) + 1
          coord(1, i) = coord(1, i) - 1
          coord(2, i) = coord(2, i) - 1
        Case 22
          coord(1, i) = coord(1, i) - 1
          coord(2, i) = coord(2, i) - 1
        Case 23
          coord(0, i) = coord(0, i) - 1
          coord(1, i) = coord(1, i) - 1
          coord(2, i) = coord(2, i) - 1
        Case 24
          coord(0, i) = coord(0, i) - 1
          coord(2, i) = coord(2, i) - 1
        Case 25
          coord(0, i) = coord(0, i) - 1
          coord(1, i) = coord(1, i) + 1
          coord(2, i) = coord(2, i) - 1
        Case 26
          coord(2, i) = coord(2, i) - 1
      End Select

      'check if point still in the field
      If coord(0, i) > d - 1 Or coord(1, i) > d - 1 Or coord(1, i) > d - 1 Or coord(0, i) < 0 Or coord(1, i) < 0 Or coord(2, i) < 0 Then
        GoTo newrandompoint
      End If

      GoTo checkneighbour

      downlow:
      'adds coordinates to the output
      vecList.Add(New On3dVector(coord(0, i), coord(1, i), coord(2, i)))
      linelist.Add(New OnLine(oldpoint, newpoint))

    Next

    A = veclist
    B = linelist
# ---------- end vb_2 ----------
radius = Slider(0.1, range=0.1..1)
pt = Point(vb.A)
crv = Curve(vb.B)
sph = Sphere(Base=pt, Radius=radius)
pipe = Pipe(Curve=crv, Radius=radius, Caps=0)
