# Grasshopper definition ORGANICITIES_MassingToolboxH2_0.gh (Grasshopper 0.9.76)

# DESIGN.EPFL.CH/ORGANICITES
# ORGANICITIES: Definition originally written by:
#             Trevor Patt
# 
# 
#   in collaboration with the MediaxDesign Lab, EPFL
# 
#   Creative Commons:
#     Attribution
#     NonCommercial
#     ShareAlike
inputpanel = Panel("{0,0,0}")

# ---- group: Read Multipoint Slider
# 0111-2014
gradient = Gradient(
    LowerLimit=0,
    UpperLimit=1,
    Parameter=[0, 0.01, 0.02, 0.03, 0.04, 0.05, 0.06, 0.07, 0.08, 0.09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],
    stops=[0.257: RGB(255, 255, 255), 0.635: RGB(0, 0, 1), 0.905: RGB(255, 255, 254)])
vb = VBScript(x=gradient)  # -> out, t; inputs x: list of Color
# ---------- vb: VB ----------
    Dim tval As New list(Of Double)
    Dim xct As Int32 = x.Count - 1
    tval.add(0)
    For i As int32 =1 To xct
      Dim r0 As  int32 = x(i).r: Dim r1 As  int32 = x(i - 1).r
      If (math.abs(r0 - r1) > 10) And (x(i).r = 0 Or x(i).r = 255)Then
        tval.add(i / xct)
        print(“Split segment at “ & Math.Round((i / xct), 2))
      End If
    Next
    tval.add(1)
    t = tval
# ---------- end vb ----------

# ---- group: Create Primary Axis
degrees = Slider(-59.2, range=-180..180)
origin_pt = Point(inputpanel)
to_rad = VariableExpression(a=degrees, Expression="rad(a)")
vb_2 = VBScript(cnt=origin_pt, ang=to_rad, lng="20")  # -> out, ln; inputs cnt: Point3d
# ---------- vb_2: VB ----------
    Dim xval As Double = lng / 2 * math.Cos(ang)
    Dim yval As Double = lng / 2 * math.Sin(ang)

    Dim enpt As New Point3d(cnt.x + xval, cnt.y + yval, cnt.z)
    Dim stpt As New Point3d(cnt.x - xval, cnt.y - yval, cnt.z)

    Dim lnout As New Line(stpt, enpt)
    ln = lnout
# ---------- end vb_2 ----------
cir = Circle(Plane=origin_pt, Radius=0.2)

# ---- group: Split and Bend Axis
degrees_2 = Slider(32.4, range=-180..180)
degrees_3 = Slider(4.8, range=-180..180)
rad = Radians(Degrees=degrees_2)
rad_2 = Radians(Degrees=degrees_3)
merge = MergeMultiple(Stream0=rad, Stream1=rad_2)
crv_ln = Curve(vb_2.ln)
num_t = Number(vb.t)
vb_3 = VBScript(ln=crv_ln, t=num_t, ang=merge)  # -> out, pt, vec, a; inputs ln: Line, t: list, ang: list
# ---------- vb_3: VB ----------
    Dim i As Int32:Dim ck As Int32 = 0
    Dim ct As Int32 = t.Count - 1
    Dim loTmp As New list(Of Double):Dim hi As New list(Of Double):Dim lo As New list(Of Double)
    Dim loAng As New list(Of Double):Dim hiAng As New list(Of Double):Dim angval As New list(Of Double)

    Dim pta As New list(Of Point3d):Dim ptb As New list(Of Point3d)
    Dim mdpt As New Point3d(ln.PointAt(.5))
    ‘Dim ang0 As Double = a0
    ‘ang0 = math.Atan((ln.PointAt(1).y - ln.PointAt(0).y) / (ln.PointAt(1).x - ln.PointAt(0).x))

    ‘SEPARATE Into LO And HI
    For i = 0 To ct
      If t(i) < .5 Then
        lo.add(t(i))
      Else
        hi.add(t(i))
        pta.add(ln.pointat(t(i)))
      End If
    Next

    ‘REVERSE DIRECTION Of LO LIST
    lo.reverse
    For i = 0 To lo.count - 1
      ‘lo.add(loTmp(i))
      ptb.add(ln.pointat(lo(i)))
    Next
    ‘MATCH ANGLES To LO
    For i = lo.count - 2 To 0 Step -1
      loAng.add(-ang(i Mod ang.count))
      ck += 1
    Next
    ‘MATCH ANGLES To HI
    For i = 0 To pta.Count - 1
      hiAng.add(ang((ck + i) Mod ang.count))
    Next
    ‘ROTATE LO
    If lo.count > 1 Then
      RotateSEGMENTS(ptb, loAng, ang0, math.pi)

    End If
    ‘ROTATE HI
    If hi.count > 1 Then
      RotateSEGMENTS(pta, hiAng, ang0, 0)

    End If

    ptb.reverse
    Dim ptout As New List(Of Point3d)
    For Each ptx As Point3d In ptb
      ptout.Add(ptx)
    Next
    For Each ptx As Point3d In pta
      ptout.Add(ptx)
    Next

    pt = ptout

    Dim tng As New list(Of Vector3d)
    tng = GetORTHO(ptout, angval)
    vec = tng
    a = angval
# ---------- vb_3: VB additional code ----------
  Sub RotateSEGMENTS(ByVal pt As list(Of Point3d), ByVal ang As list(Of Double), ByVal a0 As Double, ByRef posneg As Double)
    Dim i As Int32 = -1:Dim j As int32

    Dim sumAng As New List(Of Double)
    For Each aN As Double In ang
      If i > 0 Then posneg = 0
      a0 += (aN + (i * posneg))
      sumAng.add(a0)
      i += 1
    Next

    For i = 0 To pt.count - 2
      For j = i + 1 To pt.count - 1

        Dim dist As Double = pt(i).distanceto(pt(j))
        Dim xval As Double = dist * math.Cos(sumang(i))
        Dim yval As Double = dist * math.Sin(sumang(i))
        Dim addvec As New Vector3d(xval, yval, 0)
        pt(j) = pt(i) + addvec
      Next
    Next

  End Sub

  Function GetORTHO(ByRef pt As list(Of Point3d), ByVal angval As list(Of Double)) As list(Of Vector3d)
    Dim vecout As New list(Of Vector3d)

    For i As int32= 0 To pt.count - 1
      Dim vec As New Vector3d
      If i <> 0 Then
        Dim tmpvec As New Vector3d(pt(i) - pt(i - 1))
        tmpvec.unitize
        vec += tmpvec
      End If

      If i <> pt.count - 1 Then
        Dim tmpvec As New Vector3d(pt(i + 1) - pt(i))
        tmpvec.unitize
        vec += tmpvec
      End If
      vec.unitize
      Dim vecOrth As New Vector3d(-vec.y, vec.x, vec.z)
      vecout.add(vecorth)


      Dim angtmp As Double = math.atan(vecorth.y / vecorth.x)
      If vecorth.x < 0 Then angtmp += math.pi
      angval.add(angtmp)

    Next


    GetORTHO = vecout
  End Function
# ---------- end vb_3 ----------
pt_center = Point(vb_3.pt)

# ----
pt_center_2 = Point(vb_3.pt)
pt_center_3 = Point(vb_3.pt)

# ---- group: OFFSET
offset_to_inside = BooleanToggle(False)
offset_to_inside_2 = BooleanToggle(True)
panel = Panel(""".5
1.5
2.5
2.5""")
panel_2 = Panel("""1.5
1
1
2.5""")
vb_var_offset = VBScript(pt=pt_center_2, io=offset_to_inside, ofs=panel)  # -> out, A; inputs pt: list of Point3d, ofs: list
# ---------- vb_var_offset: VB ----------
    print("closed:" & cl.ToString)
    Dim curves_temp() As Curve = Nothing
    Dim curves_out As New List (Of Curve)
    Dim pts_out As New List (Of Point3d)
    Dim i As Integer = 0

    Dim stpt As New List (Of Point3d)
    Dim enpt As New List (Of Point3d)
    Dim cntrs As New list (Of Point3d)


    For i = 0 To pt.count - 2
      Dim cnpt As New Point3d
      print(i)

      Dim mdpt As New Point3d((pt(i) + pt(i + 1)) / 2)
      Dim segvec As New Vector3d (pt(i + 1) - pt(i))

      Dim xvec As New Vector3d (Vector3d.CrossProduct(segvec, Vector3d.ZAxis))
      'SWITCH SIDE OF OFFSET IF IO=FALSE
      If Not io Then  xvec *= -1

      cnpt = mdpt + xvec
      cntrs.add(cnpt)
      Dim lnSeg As New Line(pt(i), pt(i + 1))
      'crvseg.Split(t(i+1),cL,cR)
      Dim crvseg As New LineCurve(lnseg, 0, 1)


      curves_temp = crvSeg.Offset(cnpt, Vector3d.ZAxis, ofs(i Mod ofs.count), 0.01, 1)
      curves_out.Add(curves_temp(0))

      stpt.add(curves_temp(0).PointAtStart)
      enpt.add(curves_temp(0).PointAtEnd)
    Next


    'FOR OPEN CURVES BEGIN WITH OFFSET START POINT
    If Not cl Then
      pts_out.Add(stpt(0))
    End If

    Dim j As Integer = 0

    For Each ptct As Point3d In stpt
      'For j = 0 To 1
      Dim k As Integer = (j + 1) Mod (stpt.count)
      Dim Aj As Double = (enpt(j).y - stpt(j).y)
      Dim Bj As Double = (enpt(j).x - stpt(j).x)
      'Dim Cj As Double = (Aj * stpt(j).x) + (Bj * stpt(j).x)

      Dim Ak As Double = (enpt(k).y - stpt(k).y)
      Dim Bk As Double = (enpt(k).x - stpt(k).x)
      'Dim Ck As Double = (Ak * stpt(k).x) + (Bk * stpt(k).x)

      'Print(j & ":" & k & " / " & i)

      Dim det As Double = (Ak * Bj) - (Bk * Aj)

      Dim xVal As Double
      Dim yVal As Double
      If (det = 0) Then

        'Exit For
      Else
        Dim Ua As Double = ((Bk * (stpt(j).y - stpt(k).y)) - (Ak * (stpt(j).x - stpt(k).x))) / det

        xVal = stpt(j).x + (Ua * Bj)
        yVal = stpt(j).y + (Ua * Aj)
      End If

      Dim ptTemp As New Point3d
      ptTemp.x = xVal
      ptTemp.y = yVal
      ptTemp.z = enpt(j).z
      pts_out.Add(ptTemp)
      j += 1
    Next

    'FOR OPEN CURVES BEGIN WITH OFFSET START POINT
    If Not cl Then
      pts_out(j) = (enpt(j - 1))
    End If

    A = pts_out
    'B = curves_out
    'B = cntrs
# ---------- end vb_var_offset ----------
vb_var_offset_2 = VBScript(pt=pt_center_3, io=offset_to_inside_2, ofs=panel_2)  # -> out, B; inputs pt: list of Point3d, ofs: list
# ---------- vb_var_offset_2: VB ----------
    print("closed:" & cl.ToString)
    Dim curves_temp() As Curve = Nothing
    Dim curves_out As New List (Of Curve)
    Dim pts_out As New List (Of Point3d)
    Dim i As Integer = 0

    Dim stpt As New List (Of Point3d)
    Dim enpt As New List (Of Point3d)
    Dim cntrs As New list (Of Point3d)


    For i = 0 To pt.count - 2
      Dim cnpt As New Point3d
      print(i)

      Dim mdpt As New Point3d((pt(i) + pt(i + 1)) / 2)
      Dim segvec As New Vector3d (pt(i + 1) - pt(i))

      Dim xvec As New Vector3d (Vector3d.CrossProduct(segvec, Vector3d.ZAxis))
      'SWITCH SIDE OF OFFSET IF IO=FALSE
      If Not io Then  xvec *= -1

      cnpt = mdpt + xvec
      cntrs.add(cnpt)
      Dim lnSeg As New Line(pt(i), pt(i + 1))
      'crvseg.Split(t(i+1),cL,cR)
      Dim crvseg As New LineCurve(lnseg, 0, 1)


      curves_temp = crvSeg.Offset(cnpt, Vector3d.ZAxis, ofs(i Mod ofs.count), 0.01, 1)
      curves_out.Add(curves_temp(0))

      stpt.add(curves_temp(0).PointAtStart)
      enpt.add(curves_temp(0).PointAtEnd)
    Next


    'FOR OPEN CURVES BEGIN WITH OFFSET START POINT
    If Not cl Then
      pts_out.Add(stpt(0))
    End If

    Dim j As Integer = 0

    For Each ptct As Point3d In stpt
      'For j = 0 To 1
      Dim k As Integer = (j + 1) Mod (stpt.count)
      Dim Aj As Double = (enpt(j).y - stpt(j).y)
      Dim Bj As Double = (enpt(j).x - stpt(j).x)
      'Dim Cj As Double = (Aj * stpt(j).x) + (Bj * stpt(j).x)

      Dim Ak As Double = (enpt(k).y - stpt(k).y)
      Dim Bk As Double = (enpt(k).x - stpt(k).x)
      'Dim Ck As Double = (Ak * stpt(k).x) + (Bk * stpt(k).x)

      'Print(j & ":" & k & " / " & i)

      Dim det As Double = (Ak * Bj) - (Bk * Aj)

      Dim xVal As Double
      Dim yVal As Double
      If (det = 0) Then

        'Exit For
      Else
        Dim Ua As Double = ((Bk * (stpt(j).y - stpt(k).y)) - (Ak * (stpt(j).x - stpt(k).x))) / det

        xVal = stpt(j).x + (Ua * Bj)
        yVal = stpt(j).y + (Ua * Aj)
      End If

      Dim ptTemp As New Point3d
      ptTemp.x = xVal
      ptTemp.y = yVal
      ptTemp.z = enpt(j).z
      pts_out.Add(ptTemp)
      j += 1
    Next

    'FOR OPEN CURVES BEGIN WITH OFFSET START POINT
    If Not cl Then
      pts_out(j) = (enpt(j - 1))
    End If

    B = pts_out
    'B = curves_out
    'B = cntrs
# ---------- end vb_var_offset_2 ----------
pline = PolyLine(Vertices=vb_var_offset.A, Closed=False)
pt_a = Point(vb_var_offset.A)
pline_2 = PolyLine(Vertices=vb_var_offset_2.B, Closed=False)
pt_b = Point(vb_var_offset_2.B)

# ---- group: SHEAR POINTS
pt_a_2 = Point(pt_a)
pt_b_2 = Point(pt_b)
vb_shear = VBScript(a=pt_a_2, b=pt_b_2, shr=Slider(0.7, range=-1..1))  # -> out, a, b; inputs a: list of Point3d, b: list of Point3d
# ---------- vb_shear: VB ----------
    Dim i As Int32
    Dim ptA As New List(Of Point3d)
    Dim ptB As New List(Of Point3d)

    For i = 0 To a.Count - 1
      Dim pct As Double = shr * 2 * i / (a.Count - 1) - shr
      pct /= 2
      Dim vec As New Vector3d(b(i) - a(i))
      vec *= pct
      Dim tmpA As New Point3d(a(i) + vec)
      ptA.add(tmpA)
      Dim tmpB As New Point3d(b(i) + vec)
      ptB.add(tmpB)
    Next

    a_ = ptA
    b_ = ptB
# ---------- end vb_shear ----------
pline_3 = PolyLine(Vertices=vb_shear.a, Closed=False)
pline_4 = PolyLine(Vertices=vb_shear.b, Closed=False)
ln = Line(StartPoint=vb_shear.a, EndPoint=vb_shear.b)

# ---- group: PLANAR ROOF
pt_center_4 = Point(vb_3.pt)
origin_pt_2 = Point(inputpanel)
pt_b_3 = Point(vb_var_offset_2.B)
panel_3 = Panel("""5
4
4
2
3""")
pt_a_3 = Point(vb_var_offset.A)
vb_planarroof = VBScript(a=pt_a_3, b=pt_b_3, c=pt_center_4, ht=panel_3, cnt=origin_pt_2)  # -> out, a, b, c, per; inputs a: list of Point3d, b: list of Point3d, c: list of Point3d, ht: list, cnt: Point3d
# ---------- vb_planarroof: VB ----------
    Dim loNdx As New list(Of int32)
    Dim hiNdx As New list(Of int32)
    GetLOHI(c, cnt, loNdx, hiNdx)

    Dim pt0 As New Point3d(c(loNdx.count - 1).x, c(loNdx.count - 1).y, c(loNdx.count - 1).z + ht(0))
    Dim pt1 As New Point3d(c(loNdx.count).x, c(loNdx.count).y, c(loNdx.count).z + ht(0))
    'mid on ridgeline
    Dim pt1lst As New list(Of Point3d)
    pt1lst.add(pt0):pt1lst.add(pt1)

    'lo on ridgeline
    Dim pt2lst As New list(Of Point3d)
    pt2lst.add(pt1lst(0))
    GetPT2(loNdx, c, ht, pt2lst)
    'hi on ridgeline
    Dim pt3lst As New list(Of Point3d)
    pt3lst.add(pt1lst(1))
    GetPT3(hiNdx, loNdx.count, c, ht, pt3lst)

    'mid on side a
    Dim pt4lst As New list(Of Point3d)
    GetPT45(loNdx.count - 1, a, pt1lst, ht(3), pt4lst)
    'mid on side b
    Dim pt5lst As New list(Of Point3d)
    GetPT45(loNdx.count - 1, b, pt1lst, ht(4), pt5lst)

    'lo on side a
    Dim pt6lst As New list(Of Point3d)
    pt6lst.add(pt4lst(0))
    GetPT67(loNdx, a, pt2lst, pt6lst)
    'lo on side b
    Dim pt7lst As New list(Of Point3d)
    pt7lst.add(pt5lst(0))
    GetPT67(loNdx, b, pt2lst, pt7lst)

    'hi on side a
    Dim pt8lst As New list(Of Point3d)
    pt8lst.add(pt4lst(1))
    GetPT89(loNdx.count, a, pt3lst, pt8lst)
    'hi on side b
    Dim pt9lst As New list(Of Point3d)
    pt9lst.add(pt5lst(1))
    GetPT89(loNdx.count, b, pt3lst, pt9lst)

    Dim sideA As New list(Of Point3d)
    AddLIST(sideA, pt6lst, -1)
    AddLIST(sideA, pt8lst, 1)

    Dim sideB As New list(Of Point3d)
    AddLIST(sideB, pt7lst, -1)
    AddLIST(sideB, pt9lst, 1)

    Dim newC As New list(Of Point3d)
    AddLIST(newC, pt2lst, -1)
    AddLIST(newC, pt3lst, 1)


    Dim newP As New list(Of Point3d)
    AddLIST(newP, sideA, 1)
    newP.add(newC(newC.count - 1))
    AddLIST(newP, sideB, -1)
    newP.add(newC(0))
    newP.add(newP(0))

    a_ = sideA
    b_ = sideB
    c_ = newC
    per = newP
# ---------- vb_planarroof: VB additional code ----------
  Sub GetLOHI(ByRef pts As list(Of Point3d), ByVal cnt As Point3d, ByRef loNdx As list(Of int32), ByRef hiNdx As list(Of int32))
    Dim pl As New Polyline
    For Each vtx As Point3d In pts
      pl.add(vtx)

    Next

    Dim md As Double
    md = cnt.DistanceTo(pl.ClosestPoint(cnt))
    For i As int32=0 To pts.count - 2
      Dim t As Double
      t = pts(i).DistanceTo(pl.ClosestPoint(pts(i)))
      If t < md Then
        print("t_is_smaller")
        loNdx.add(i)
      Else
        print("md_is_smaller")
        hiNdx.add(i)
      End If
    Next


  End Sub

  Sub GetPT2(ByRef lo As list(Of int32), ByRef pts As list(Of Point3d), ByRef ht As list(Of Double), ByVal pt2lst As list(Of Point3d))
    Dim ct As Int32 = lo.count - 1
    For i As int32 =ct - 1 To 0 Step -1
      Dim htdlt As Double = (ht(0) - ht(1)) / (ct)
      Dim htval As Double = i * htdlt + (ht(1))

      Dim tmppt As New Point3d(pts(i).x, pts(i).y, pts(i).z + htval)
      pt2lst.add(tmppt)
    Next
  End Sub

  Sub GetPT3(ByRef hi As list(Of int32), ByRef basect As int32, ByRef pts As list(Of Point3d), ByRef ht As list(Of Double), ByVal pt3lst As list(Of Point3d))
    Dim ct As Int32 = hi.count - 1
    For i As int32 =1 To ct
      Dim htdlt As Double = (ht(2) - ht(0)) / (ct)
      Dim htval As Double = i * htdlt + (ht(0))

      Dim tmppt As New Point3d(pts(i + basect).x, pts(i + basect).y, pts(i + basect).z + htval)
      pt3lst.add(tmppt)
    Next
  End Sub

  Sub GetPT45(ByRef basect As int32, ByRef pts As list(Of Point3d), ByRef gpt As list(Of Point3d), ByRef ht As  Double, ByVal pt4lst As list(Of Point3d))
    Dim orgn As New Point3d((pts(basect) + pts(basect + 1)) / 2)
    orgn.z += ht
    Dim A As Double = orgn.y * (gPt(0).z - gPt(1).z) + gPt(0).y * (gPt(1).z - orgn.z) + gPt(1).y * (orgn.z - gPt(0).z)
    Dim B As Double = orgn.z * (gPt(0).x - gPt(1).x) + gPt(0).z * (gPt(1).x - orgn.x) + gPt(1).z * (orgn.x - gPt(0).x)
    Dim C As Double = orgn.x * (gPt(0).y - gPt(1).y) + gPt(0).x * (gPt(1).y - orgn.y) + gPt(1).x * (orgn.y - gPt(0).y)
    Dim D As Double = -(orgn.x * (gPt(0).y * gPt(1).z - gPt(1).y * gPt(0).z) + gPt(0).x * (gPt(1).y * orgn.z - orgn.y * gPt(1).z) + gPt(1).x * (orgn.y * gPt(0).z - gPt(0).y * orgn.z))
    'Print(A)
    'Print(B)
    'Print(C)
    'Print(D)

    For i As Integer = 0  To 1
      Dim zVal As Double = ((A * pts(basect + i).x) + (B * pts(basect + i).y) + D) / (-C)

      pt4lst.Add(New Point3d(pts(basect + i).x, pts(basect + i).y, zVal))
    Next
  End Sub

  Sub GetPT67(ByRef lo As list(Of int32), ByRef pts As list(Of Point3d), ByRef gpt As list(Of Point3d), ByVal pt6lst As list(Of Point3d))
    Dim ct As int32 = lo.count - 2

    For i As int32=0 To ct
      Dim orgn As New Point3d(pt6lst(i))

      Dim A As Double = orgn.y * (gPt(i).z - gPt(i + 1).z) + gPt(i).y * (gPt(i + 1).z - orgn.z) + gPt(i + 1).y * (orgn.z - gPt(i).z)
      Dim B As Double = orgn.z * (gPt(i).x - gPt(i + 1).x) + gPt(i).z * (gPt(i + 1).x - orgn.x) + gPt(i + 1).z * (orgn.x - gPt(i).x)
      Dim C As Double = orgn.x * (gPt(i).y - gPt(i + 1).y) + gPt(i).x * (gPt(i + 1).y - orgn.y) + gPt(i + 1).x * (orgn.y - gPt(i).y)
      Dim D As Double = -(orgn.x * (gPt(i).y * gPt(i + 1).z - gPt(i + 1).y * gPt(i).z) + gPt(i).x * (gPt(i + 1).y * orgn.z - orgn.y * gPt(i + 1).z) + gPt(i + 1).x * (orgn.y * gPt(i).z - gPt(i).y * orgn.z))
      'Print(A)
      'Print(B)
      'Print(C)
      'Print(D)
      'print(relo(i + 1))
      Dim zVal As Double = ((A * pts(ct - i).x) + (B * pts(ct - i).y) + D) / (-C)
      pt6lst.Add(New Point3d(pts(ct - i).x, pts(ct - i).y, zVal))
    Next
  End Sub

  Sub GetPT89(ByRef basect As int32, ByRef pts As list(Of Point3d), ByRef gpt As list(Of Point3d), ByVal pt8lst As list(Of Point3d))

    For i As int32=0 To pts.count - basect - 2
      Dim orgn As New Point3d(pt8lst(i))

      Dim A As Double = orgn.y * (gPt(i).z - gPt(i + 1).z) + gPt(i).y * (gPt(i + 1).z - orgn.z) + gPt(i + 1).y * (orgn.z - gPt(i).z)
      Dim B As Double = orgn.z * (gPt(i).x - gPt(i + 1).x) + gPt(i).z * (gPt(i + 1).x - orgn.x) + gPt(i + 1).z * (orgn.x - gPt(i).x)
      Dim C As Double = orgn.x * (gPt(i).y - gPt(i + 1).y) + gPt(i).x * (gPt(i + 1).y - orgn.y) + gPt(i + 1).x * (orgn.y - gPt(i).y)
      Dim D As Double = -(orgn.x * (gPt(i).y * gPt(i + 1).z - gPt(i + 1).y * gPt(i).z) + gPt(i).x * (gPt(i + 1).y * orgn.z - orgn.y * gPt(i + 1).z) + gPt(i + 1).x * (orgn.y * gPt(i).z - gPt(i).y * orgn.z))
      Print(A)
      Print(B)
      Print(C)
      Print(D)

      Dim zVal As Double = ((A * pts(basect + i + 1).x) + (B * pts(basect + i + 1).y) + D) / (-C)
      pt8lst.Add(New Point3d(pts(basect + i + 1).x, pts(basect + i + 1).y, zVal))
    Next
  End Sub

  Sub AddLIST(ByVal L As list(Of Point3d), ByRef pts As list(Of Point3d), ByRef posneg As int32)
    If posneg > 0 Then
      For Each pt As Point3d In pts
        L.add(pt)
      Next
    Else
      For i As int32=pts.count - 1 To 0 Step -1
        L.add(pts(i))
      Next
    End If

  End Sub
# ---------- end vb_planarroof ----------
vb_wrap = VBScript(a=pt_a_3, b=pt_b_3, c=pt_center_4)  # -> out, per, pts; inputs a: list of Point3d, b: list of Point3d, c: list of Point3d
# ---------- vb_wrap: VB ----------
    Dim i As int32
    Dim pl As New Polyline
    Dim pt As New list(Of Point3d)

    For i = 0 To a.Count - 1
      pl.add(a(i))
      pt.add(a(i))
    Next
    pl.add(c(c.count - 1))
    pt.add(c(c.Count - 1))

    For i = b.Count - 1 To 0 Step -1
      pl.add(b(i))
      pt.add(b(i))
    Next
    pl.add(c(0))
    pt.add(c(0))
    pl.add(pl(0))
    per = pl
    pts = pt
# ---------- end vb_wrap ----------
pline_5 = PolyLine(Vertices=vb_planarroof.per, Closed=False)
pline_6 = PolyLine(Vertices=vb_planarroof.c, Closed=False)
pline_7 = PolyLine(Vertices=vb_planarroof.a, Closed=False)
pline_8 = PolyLine(Vertices=vb_planarroof.b, Closed=False)
merge_2 = MergeMultiple(Stream0=flatten(pline_5), Stream1=flatten(vb_wrap.per))
merge_3 = MergeMultiple(Stream0=pline_7, Stream1=pline_6, Stream2=pline_8)
loft = Loft(Curves=merge_3, Options={Adjust=False, Closed=False, LoftEnds=3, LoftSimp=0, LoftType=3, Rebuild=10, Refit=0.01})
loft_2 = Loft(Curves=merge_2, Options={Adjust=False, Closed=False, LoftEnds=3, LoftSimp=0, LoftType=0, Rebuild=10, Refit=0.01})

# ----
num_t_2 = Number(vb.t)
crv_ln_2 = Curve(vb_2.ln)
