# Grasshopper definition ORGANICITIES_TowerBlend.gh (Grasshopper 0.9.76)

# ---- group: Initial Curves
# DESIGN.EPFL.CH/ORGANICITES
inputpanel = Panel("""{0,20,0}
{5,20,40}
{0,20,80}""")
# ORGANICITIES: Definition originally written by:
#             Trevor Patt
# 
# 
#   in collaboration with the MediaxDesign Lab, EPFL
# 
#   Creative Commons:
#     Attribution
#     NonCommercial
#     ShareAlike
inputpanel_2 = Panel("""{5,5,0}
{-20,0,40}
{-20,20,80}""")
# 0111-2014
inputpanel_3 = Panel("""{-20,-20,0}
{-15,-15,40}
{-20,-20,80}""")
intcrv = Interpolate(Vertices=inputpanel, Degree=3, Periodic=False, KnotStyle=1)  # -> Curve, Length, Domain
intcrv_2 = Interpolate(Vertices=inputpanel_2, Degree=3, Periodic=False, KnotStyle=1)  # -> Curve, Length, Domain
intcrv_3 = Interpolate(Vertices=inputpanel_3, Degree=3, Periodic=False, KnotStyle=1)  # -> Curve, Length, Domain

# ---- group: Input Curves
# INPUT
crv_input = Curve(reparameterize([intcrv.Curve, intcrv_2.Curve, intcrv_3.Curve]))

# ---- group: Tower Segments
slider = Slider(7, range=0..16)

# ---- group: Tower Facets
slider_2 = Slider(6, range=0..16)

# ---- group: Tower Radius
slider_3 = Slider(6.8, range=0..10)

# ---- group: Threshold Angle
slider_4 = Slider(86, range=0..100)

# ---- group: Attraction Threshold
slider_5 = Slider(22.7, range=0..100)

# ---- group: Plates Per Segment
slider_6 = Slider(5, range=0..10)

# ----
crv_input_2 = Curve(reparameterize(crv_input))
int_twrseg = Integer(slider)
int_twrfacet = Integer(slider_2)
num_twrrad = Number(slider_3)
int_threshang = Integer(slider_4)
num_threshattract = Number(slider_5)
int_plates = Integer(slider_6)

# ---- group: 01_Determine Tower Min Height
crv_input_3 = Curve(reparameterize(crv_input))
end = EndPoints(Curve=crv_input_3)  # -> Start, End
pt = Point(end.End)
pdecon = Deconstruct(Point=pt)  # -> XComponent, YComponent, ZComponent
bnd = Bounds(Numbers=pdecon.ZComponent)
dedomain = DeconstructDomain(Domain=bnd)  # -> Start, End

# ---- group: 02_SubdivideTowerHeight
num_minheight = Number(dedomain.Start)
int_twrseg_2 = Integer(slider)
division = Division(A=num_minheight, B=int_twrseg_2)
series = Series(Start=0, Step=division, Count=expr("x+1", int_twrseg_2))
xy = XYPlane(Origin=Point(0, 0, 0))
Z = UnitZ(Factor=series)
move = Move(Geometry=xy, Motion=Z)  # -> Geometry, Transform

# ---- group: 03_create frames on base curves
pln_segmentlocations = Plane(move.Geometry)
crv_input_4 = Curve(reparameterize(graft(crv_input_2)))
pcx = CurvePlane(Curve=crv_input_4, Plane=pln_segmentlocations)  # -> Points, ParamsC, ParamsP
path_mapper = PathMapper(pcx.ParamsC, source="{a;b;c}", target="{a;b}")
hframe = HorizontalFrame(Curve=crv_input_4, Parameter=path_mapper)
align = AlignPlanes(Planes=hframe)

# ---- group: 04_Vertices_Tower Segments
int_twrfacet_2 = Integer(slider_2)
num_twrrad_2 = Number(slider_3)
range = Range(Domain="0 to 2*pi", Steps=int_twrfacet_2)
split = SplitList(List=range, Index=int_twrfacet_2)  # -> ListA, ListB
eval = Evaluate(F="r*sin(a)", a=split.ListA, r=num_twrrad_2)
eval_2 = Evaluate(F="r*cos(a)", a=split.ListA, r=num_twrrad_2)

# ----
pln_segments = Plane(graft(align))

# ---- group: 05_Segment Profiles
num_ucoord = Number(eval)
num_vcoord = Number(eval_2)
path_mapper_2 = PathMapper(pln_segments, source="{a;b;c}", target="{a;b;0;c}")
pt_2 = PointOriented(BasePlane=pln_segments, UComponent=num_ucoord, VComponent=num_vcoord, WComponent=0)
pline = PolyLine(Vertices=pt_2, Closed=True)

# ---- group: 06_Tower_InitialProfiles
crv_segmentprofiles = Curve(pline)
path_mapper_3 = PathMapper(crv_segmentprofiles, source="{A;B;C;D}", target="{B}")
loft = Loft(Curves=path_mapper_3, Options={Adjust=False, Closed=False, LoftEnds=0, LoftSimp=0, LoftType=0, Rebuild=10, Refit=0.01})

# ----
pln_segments_2 = Plane(graft(align))
int_threshang_2 = Integer(slider_4)
num_threshattract_2 = Number(slider_5)
int_twrseg_3 = Integer(slider)

# ---- group: 07_Closest Points Between Towers
crv_input_5 = Curve(reparameterize(crv_input))
pt_vertexpoints = Point(pt_2)
lng = ListLength(List=crv_input_5)
path_mapper_4 = PathMapper(pt_vertexpoints, source="{A;B;C;D}", target="{B;D}")
int = Integer(int_twrseg_3)
vb_closestpoints = VBScript(pts=path_mapper_4, crv=lng, div=int)  # -> out, A, B; inputs pts: tree of Point3d
# ---------- vb_closestpoints: VB ----------
    Dim ptOut As New DataTree (Of point3d)
    Dim distOut As New dataTree (Of Double)

    For i As int32=0 To crv - 1
      For j As int32=0 To div
        Dim pathIJ As New GH_Path(i, j)
        For k As int32=0 To pts.Branch(pathIJ).Count - 1
          'Variable to Compare to for finding shortest distance
          Dim distTemp As Double = 100000
          'Variables to save closest point's location in tree
          Dim mVal As int32
          Dim nVal As int32



          For m As int32=0 To crv - 1

            'Only Compare distances when i and m are not the same
            If i <> m Then

              Dim pathMJ As New GH_Path(m, j)
              For n As int32=0 To pts.Branch(pathMJ).Count - 1

                Dim dist As Double = pts(pathIJ, k).distanceto(pts(pathMJ, n))

                If dist < distTemp Then
                  distTemp = dist
                  mVal = m
                  nVal = n
                End If


                'Close n Loop
              Next

            End If
            'Close m Loop
          Next

          Dim pthOUt As New gh_path(mval, j)
          ptout.add(pts(pthOut, nVal), pathIJ)
          distout.add(distTemp, pathIJ)



          'Close K Loop
        Next
        'Close J Loop
      Next
      'Close I Loop
    Next

    a = ptout
    b = distout
# ---------- end vb_closestpoints ----------

# ---- group: 08_Lines From Closest Points
pt_vertexpoints_2 = Point(pt_2)
pt_closestpoints = Point(vb_closestpoints.A)
path_mapper_5 = PathMapper(pln_segments_2, source="{A;B;C;D}", target="{B;D}")
path_mapper_6 = PathMapper(pt_vertexpoints_2, source="{A;B;C;D}", target="{B;D}")
pt_center = Point(path_mapper_5)
pt_vertexpoints_3 = Point(path_mapper_6)
ln = Line(StartPoint=pt_vertexpoints_3, EndPoint=pt_center)
ln_2 = Line(StartPoint=pt_vertexpoints_3, EndPoint=pt_closestpoints)

# ---- group: 09_Evaluate Length and Angle of Connection
num_distances = Number(vb_closestpoints.B)
line_centertovertex = Line(ln)
line_vertextoclosest = Line(ln_2)
angle = Angle(VectorA=line_centertovertex, VectorB=line_vertextoclosest)  # -> Angle, Reflex
larger = LargerThan(FirstNumber=angle.Angle, SecondNumber=expr("rad(x)", int_threshang_2))  # -> LargerThan, OrEqualTo
smaller = SmallerThan(FirstNumber=num_distances, SecondNumber=num_threshattract_2)  # -> SmallerThan, OrEqualTo
and = GateAnd(A=larger.LargerThan, B=smaller.SmallerThan)

# ---- group: 10_Move Points Along Vectors
line_vertextoclosest_2 = Line(ln_2)
bool_makeconnection = Boolean(and)
pt_vertexpoints_4 = Point(path_mapper_6)
vec = Vector(line_vertextoclosest_2)
graft = GraftTree(Data=vec, IncludeEmptyLists=True, IncludeNullItems=True)
graft_2 = GraftTree(Data=bool_makeconnection, IncludeEmptyLists=True, IncludeNullItems=True)
graft_3 = GraftTree(Data=pt_vertexpoints_4, IncludeEmptyLists=True, IncludeNullItems=True)
cull = CullPattern(List=graft, CullPattern=graft_2)
dispatch = Dispatch(List=graft_3, DispatchPattern=graft_2)  # -> ListA, ListB
pt_3 = Point(dispatch.ListA)
eval_3 = Evaluate(F="p+(v/2)", v=cull, p=pt_3)

# ---- group: 11_Create Modified Profile Curves
pt_connect = Point(eval_3)
pt_noconnection = Point(dispatch.ListB)
merge = Merge(Data1=pt_connect, Data2=pt_noconnection)
clean = CleanTree(Data=merge, CleanInvalid=True, CleanEmpty=False)
path_mapper_7 = PathMapper(clean, source="{a;b;c}", target="{a;b}")
pline_2 = PolyLine(Vertices=path_mapper_7, Closed=True)

# ---- group: 12_Loft New Profile Curves
crv_modifiedprofiles = Curve(pline_2)
path_mapper_8 = PathMapper(crv_modifiedprofiles, source="{a;b}", target="{a}")
loft_2 = Loft(Curves=path_mapper_8, Options={Adjust=False, Closed=False, LoftEnds=0, LoftSimp=0, LoftType=3, Rebuild=10, Refit=0.01})

# ---- group: 13_Test Surfaces for Planarity
brep_towerskin = Brep(loft_2)
explode = BrepComponents(Brep=brep_towerskin)  # -> Faces, Edges, Vertices
planar = Planar(Surface=explode.Faces, Interior=True)  # -> Planar, Plane
dispatch_2 = Dispatch(List=explode.Faces, DispatchPattern=planar.Planar)  # -> ListA, ListB

# ---- group: 14_Substitute Triangles for Warped Surfaces
brep_nonplanarsurfaces = Brep(dispatch_2.ListB)
srfpt = SurfacePoints(Surface=brep_nonplanarsurfaces)  # -> Points, Weights, Greville, UCount, VCount
panel = Panel("""0
1
3""")
panel_2 = Panel("""3
2
0""")
item = ListItem(List=srfpt.Points, Index=panel, Wrap=False)
item_2 = ListItem(List=srfpt.Points, Index=panel_2, Wrap=False)
pline_3 = PolyLine(Vertices=item, Closed=True)
pline_4 = PolyLine(Vertices=item_2, Closed=True)
planar_2 = PlanarSrf(Edges=[pline_4, pline_3])

# ----
pln_segmentlocations_2 = Plane(move.Geometry)
num_vcoord_2 = Number(eval_2)
num_minheight_2 = Number(dedomain.Start)
pln_segments_3 = Plane(align)
num_ucoord_2 = Number(eval)
pt_vertexpoints_5 = Point(pt_2)
crv_segmentprofiles_2 = Curve(pline)
pt_closestpoints_2 = Point(vb_closestpoints.A)
num_distances_2 = Number(vb_closestpoints.B)
line_centertovertex_2 = Line(ln)
line_vertextoclosest_3 = Line(ln_2)
bool_makeconnection_2 = Boolean(and)
pt_connect_2 = Point(eval_3)
pt_noconnection_2 = Point(dispatch.ListB)
crv_modifiedprofiles_2 = Curve(pline_2)
brep_towerskin_2 = Brep(loft_2)
brep_planarsurfaces = Brep(dispatch_2.ListA)
brep_nonplanarsurfaces_2 = Brep(dispatch_2.ListB)
brep_triangulatedskin = Brep(planar_2)
